# Grasshopper definition POLIS_activity_v1.ghx (Grasshopper 1.0.8)
# plug-ins: RhinoCodePluginGH

py3 = Python3Script()  # -> out, records, context
# ---------- py3: Python ----------
import Rhino.Geometry as RG

activity_polyline = RG.Polyline([
    RG.Point3d(60.0, 0.0, 0.0),
    RG.Point3d(70.0, 0.0, 0.0),
    RG.Point3d(70.0, 10.0, 0.0),
    RG.Point3d(60.0, 10.0, 0.0),
    RG.Point3d(60.0, 0.0, 0.0)
])

activity_zone = activity_polyline.ToNurbsCurve()

records = [
    {
        "geometry": activity_zone,
        "source_id": "DRYRUN-SOURCE-06",
        "source_need_ids": ["DRYRUN-N06"],
        "use_type": "synthetic_activity_zone",
        "accessible_connection_id": "DRYRUN-SOURCE-03",
        "unobstructed": True
    }
]

context = {
    "scenario_id": "DRYRUN-SUZ-GE-20260806-01",
    "analysis_crs": "EPSG:32651",
    "units": "m",
    "provenance_reference": "dryrun:DRYRUN-SUZ-GE-20260806-01",
    "generator_version": "1.0.0"
}
# ---------- end py3 ----------
py3_2 = Python3Script(records=py3.records, context=py3.context)  # -> out, geometry, attributes
# ---------- py3_2: Python ----------
import sys

generator_folder = "/Users/veronica/Downloads/SCIGS_rhino/preregistration/software/rhino_generators"

if generator_folder not in sys.path:
    sys.path.insert(0, generator_folder)

from activity_generator import generate

output_records = generate(records, context)

geometry = [
    item["geometry"]
    for item in output_records
]

attributes = [
    item["attributes"]
    for item in output_records
]

print(
    "PASS: activity generator created "
    + str(len(output_records))
    + " objects"
)
# ---------- end py3_2 ----------
panel = Panel(py3_2.out)
panel_2 = Panel(py3_2.attributes)
