# Grasshopper definition POLIS_hydrology_v1.ghx (Grasshopper 1.0.8)
# plug-ins: RhinoCodePluginGH

py3 = Python3Script()  # -> out, records, context
# ---------- py3: Python ----------
import Rhino.Geometry as RG

hydrology_polyline = RG.Polyline([
    RG.Point3d(40.0, 0.0, 0.0),
    RG.Point3d(44.0, 0.0, 0.0),
    RG.Point3d(44.0, 3.0, 0.0),
    RG.Point3d(40.0, 3.0, 0.0),
    RG.Point3d(40.0, 0.0, 0.0)
])

hydrology_zone = hydrology_polyline.ToNurbsCurve()

records = [
    {
        "geometry": hydrology_zone,
        "source_id": "DRYRUN-SOURCE-04",
        "source_need_ids": ["DRYRUN-N04"],
        "design_storage_m3": 4.5,
        "hydraulic_type": "synthetic_storage_zone",
        "drainage_destination": "DRYRUN-SYNTHETIC-OUTFALL-01"
    }
]

context = {
    "scenario_id": "DRYRUN-SUZ-GE-20260806-01",
    "analysis_crs": "EPSG:32651",
    "units": "m",
    "provenance_reference": "dryrun:DRYRUN-SUZ-GE-20260806-01",
    "generator_version": "1.0.0"
}
# ---------- end py3 ----------
py3_2 = Python3Script(records=py3.records, context=py3.context)  # -> out, geometry, attributes
# ---------- py3_2: Python ----------
import sys

generator_folder = "/Users/veronica/Downloads/SCIGS_rhino/preregistration/software/rhino_generators"

if generator_folder not in sys.path:
    sys.path.insert(0, generator_folder)

from hydrology_generator import generate

output_records = generate(records, context)

geometry = [
    item["geometry"]
    for item in output_records
]

attributes = [
    item["attributes"]
    for item in output_records
]

print(
    "PASS: hydrology generator created "
    + str(len(output_records))
    + " objects"
)
# ---------- end py3_2 ----------
panel = Panel(py3_2.out)
panel_2 = Panel(py3_2.attributes)
