# Grasshopper definition POLIS_vegetation_v1.ghx (Grasshopper 1.0.8)
# plug-ins: RhinoCodePluginGH

py3 = Python3Script()  # -> out, records, context
# ---------- py3: Python ----------
import Rhino.Geometry as RG

# 虚拟树木点
tree_point = RG.Point3d(0.0, 0.0, 0.0)

# 与树冠不重叠的虚拟种植多边形
planting_polyline = RG.Polyline([
    RG.Point3d(10.0, 0.0, 0.0),
    RG.Point3d(14.0, 0.0, 0.0),
    RG.Point3d(14.0, 4.0, 0.0),
    RG.Point3d(10.0, 4.0, 0.0),
    RG.Point3d(10.0, 0.0, 0.0)
])

planting_curve = planting_polyline.ToNurbsCurve()

records = [
    {
        "geometry": tree_point,
        "source_id": "DRYRUN-SOURCE-01",
        "source_need_ids": ["DRYRUN-N01"],
        "planting_type": "tree",
        "species_status": "native_or_adapted",
        "shade_model_eligible": True,
        "canopy_radius_m": 2.0,
        "height_m": 7.0
    },
    {
        "geometry": planting_curve,
        "source_id": "DRYRUN-SOURCE-02",
        "source_need_ids": ["DRYRUN-N02"],
        "planting_type": "planting_zone",
        "species_status": "native_or_adapted",
        "shade_model_eligible": False
    }
]

context = {
    "scenario_id": "DRYRUN-SUZ-GE-20260806-01",
    "analysis_crs": "EPSG:32651",
    "units": "m",
    "provenance_reference": "dryrun:DRYRUN-SUZ-GE-20260806-01",
    "generator_version": "1.0.0"
}
# ---------- end py3 ----------
py3_2 = Python3Script(records=py3.records, context=py3.context)  # -> out, geometry, attributes
# ---------- py3_2: Python ----------
import sys

generator_folder = "/Users/veronica/Downloads/SCIGS_rhino/preregistration/software/rhino_generators"

if generator_folder not in sys.path:
    sys.path.insert(0, generator_folder)

from vegetation_generator import generate

output_records = generate(records, context)

geometry = [
    item["geometry"]
    for item in output_records
]

attributes = [
    item["attributes"]
    for item in output_records
]

print(
    "PASS: vegetation generator created "
    + str(len(output_records))
    + " objects"
)
# ---------- end py3_2 ----------
panel = Panel(py3_2.out)
panel_2 = Panel(py3_2.attributes)
